# Grasshopper definition extractor.gh (Grasshopper 0.9.76)
# plug-ins: Human, MetaHopper, HDTTreeUtils

get_all_loaded_libraries = CSharpScript()  # -> out, A
# ---------- get_all_loaded_libraries: C# ----------
    var libraries = Grasshopper.Instances.ComponentServer.Libraries;
    A = libraries;
# ---------- end get_all_loaded_libraries ----------
# All Loaded User Objects
get_loaded_user_objects = CSharpScript()  # -> out, A
# ---------- get_loaded_user_objects: C# ----------
    A = Grasshopper.Instances.ComponentServer.ObjectProxies.Where(o => o.Kind == GH_ObjectType.UserObject);
# ---------- end get_loaded_user_objects ----------
# User Objects from a Folder
pan = Panel("*.ghuser")
dir = DirectoryContents(FolderPath="C:\My Documents\Desktop\Source\GrasshopperUserObjects", Filter=pan, IncludeSubfolders=False)  # -> FilePaths, FileNames
assemblyinfo = CSharpScript(x=graft(get_all_loaded_libraries.A))  # -> out, A, B, C, D, E
# ---------- assemblyinfo: C# ----------
    GH_AssemblyInfo gai = x as GH_AssemblyInfo;

    A = gai.Name;
    B = gai.AuthorName;
    C = gai.AuthorContact;
    D = gai.Description;
    E = gai.IsCoreLibrary;
# ---------- end assemblyinfo ----------
getdescriptionfromuofile = CSharpScript(x=dir.FilePaths)  # -> out, A, B; inputs x: String
# ---------- getdescriptionfromuofile: C# ----------
    GH_UserObject uo = new GH_UserObject(x);
    A = uo.Description;
    B = uo.InstantiateObject();
# ---------- end getdescriptionfromuofile ----------
getdescriptionfromloadeduo = CSharpScript(x=get_loaded_user_objects.A)  # -> out, A, B, C
# ---------- getdescriptionfromloadeduo: C# ----------
    IGH_ObjectProxy proxy = x as IGH_ObjectProxy;
    A = proxy.Desc;
    try {
      B = proxy.CreateInstance();
    } catch {
    }

    C = Path.GetFileNameWithoutExtension(proxy.Location);
# ---------- end getdescriptionfromloadeduo ----------
# Library Info
assembly_name = Panel(assemblyinfo.A)
descriptions = Data(getdescriptionfromuofile.A)
descriptions_2 = Data(getdescriptionfromloadeduo.A)
filenames = Data(dir.FileNames)
filenames_2 = Data(getdescriptionfromloadeduo.C)
objects = Data(getdescriptionfromuofile.B)
objects_2 = Data(getdescriptionfromloadeduo.B)
author_name = Panel(assemblyinfo.B)
instancedescription = CSharpScript(x=descriptions_2)  # -> out, Name, Category, SubCategory, Description
# ---------- instancedescription: C# ----------
    GH_InstanceDescription desc = x as GH_InstanceDescription;
    Name = desc.Name;
    Category = desc.Category;
    SubCategory = desc.SubCategory;
    Description = desc.Description;
# ---------- end instancedescription ----------
# User Object Params
component_info = ComponentInfo(Component=objects_2)  # -> Name, NickName, Guid, ComponentGuid, Inputs, Outputs, Pivot, Bounds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

icon_save_location = Panel("C:\My Documents\Desktop\GH_Icons\UserObjects\{0}.png")
data = Data(objects_2)
componenticon = CSharpScript(x=data)  # -> out, A
# ---------- componenticon: C# ----------
    IGH_ActiveObject comp = x as IGH_ActiveObject;
    A = comp.Icon_24x24;
# ---------- end componenticon ----------
txt = Text(data)
save_all_icons = BooleanToggle(False)
format = Format(Format=icon_save_location, Culture=127, Data0=filenames_2)
c_script = CSharpScript(run=save_all_icons, BMP=componenticon.A, savePath=format)  # -> out, A; inputs run: Boolean, savePath: String
# ---------- c_script: C# ----------
    if(!run) return;
    Bitmap bmp = BMP as Bitmap;
    bmp.Save(savePath);
# ---------- end c_script ----------

category = Panel(instancedescription.Category)
output_params = Data(component_info.Outputs)
input_params = Data(component_info.Inputs)
# Icons
replace = Replace(T=category)
param_info = ParamInfo(Param=output_params)  # -> Name, NickName, DataType, Pivot, Bounds, Sources, Recipients, Kind
param_info_2 = ParamInfo(Param=input_params)  # -> Name, NickName, DataType, Pivot, Bounds, Sources, Recipients, Kind
subcategory = Panel(instancedescription.SubCategory)
author_contact = Panel(assemblyinfo.C)
# Outputs
output_param_names = Panel(param_info.Name)
# Inputs
input_param_names = Panel(param_info_2.Name)
replace_2 = Replace(T=input_param_names)
replace_3 = Replace(T=output_param_names)
format_2 = Format(Format="<{0}>{1}</{0}>", Culture=127, Data0="ParamName", Data1=replace_3)  # -> graft(Text)
format_3 = Format(Format="<{0}>{1}</{0}>", Culture=127, Data0="ParamName", Data1=replace_2)  # -> graft(Text)
replace_4 = Replace(T=subcategory)
output_param_nicknames = Panel(param_info.NickName)
input_param_nicknames = Panel(param_info_2.NickName)
library_description = Panel(assemblyinfo.D)
replace_5 = Replace(T=output_param_nicknames)
name = Panel(instancedescription.Name)
replace_6 = Replace(T=input_param_nicknames)
format_4 = Format(Format="<{0}>{1}</{0}>", Culture=127, Data0="ParamNickName", Data1=replace_5)  # -> graft(Text)
format_5 = Format(Format="<{0}>{1}</{0}>", Culture=127, Data0="ParamNickName", Data1=replace_6)  # -> graft(Text)
output_param_data_types = Panel(param_info.DataType)
input_param_data_types = Panel(param_info_2.DataType)
paramdesc = CSharpScript(x=output_params)  # -> out, A
# ---------- paramdesc: C# ----------
    IGH_Param prm = x as IGH_Param;
    A = prm.Description;
# ---------- end paramdesc ----------
replace_7 = Replace(T=name)
paramdesc_2 = CSharpScript(x=input_params)  # -> out, A; same code as paramdesc
description = Panel(instancedescription.Description)
replace_8 = Replace(T=output_param_data_types)
format_6 = Format(Format="<{0}>{1}</{0}>", Culture=127, Data0="ParamDataType", Data1=replace_8)  # -> graft(Text)
replace_9 = Replace(T=input_param_data_types)
is_core_library = Panel(assemblyinfo.E)
clean = CleanTree(RemoveNulls=True, RemoveInvalid=True, RemoveEmpty=False, Tree=paramdesc.A)
clean_2 = CleanTree(RemoveNulls=True, RemoveInvalid=True, RemoveEmpty=False, Tree=paramdesc_2.A)
format_7 = Format(Format="<{0}>{1}</{0}>", Culture=127, Data0="ParamDataType", Data1=replace_9)  # -> graft(Text)
output_param_descriptions = Panel(clean)
input_param_descriptions = Panel(clean_2)
replace_10 = Replace(T=output_param_descriptions)
format_8 = Format(Format="<{0}>{1}</{0}>", Culture=127, Data0="ParamDesc", Data1=replace_10)  # -> graft(Text)
merge = Merge(Data1=format_2, Data2=format_4, Data3=format_6, Data4=format_8)
replace_11 = Replace(T=input_param_descriptions)
format_9 = Format(Format="<{0}>{1}</{0}>", Culture=127, Data0="ParamDesc", Data1=replace_11)  # -> graft(Text)
merge_2 = Merge(Data1=format_3, Data2=format_5, Data3=format_7, Data4=format_9)
join = TextJoin(Text=merge)
replace_12 = Replace(T=description)
pan_2 = Panel("""<{0}>
{1}
</{0}>""")
join_2 = TextJoin(Text=merge_2)
getparaminfo = CSharpScript(x=get_all_loaded_libraries.A)  # -> out, flatten(Types), flatten(Categories), flatten(SubCategories), flatten(Names), flatten(Descs)
# ---------- getparaminfo: C# ----------
    GH_AssemblyInfo gai = x as GH_AssemblyInfo;
    if(gai == null) return;
    Assembly assm = null;

    List<IGH_ActiveObject> types = new List<IGH_ActiveObject>();
    List<string> compNames = new List<string>();
    List<string> subCats = new List<string>();
    List<string> Cats = new List<string>();
    List<string> compDescriptions = new List<string>();

    try {
      assm = gai.Assembly;

      if(assm == null) return;

      var componentsInAssembly = assm.GetTypes().Where(t => typeof(IGH_Param).IsAssignableFrom(t)).OrderBy(t => t.ToString());


      foreach(Type t in componentsInAssembly){
        try {
          IGH_Param param = Activator.CreateInstance(t) as IGH_Param;
          if(param.Exposure != GH_Exposure.hidden){
            types.Add(param);
            compNames.Add(param.Name);
            compDescriptions.Add(param.Description);
            subCats.Add(param.SubCategory);
            Cats.Add(param.Category);
          }

        } catch {

        }
      }

    } catch {

    }


    Types = types;
    Names = compNames;
    Descs = compDescriptions;
    SubCategories = subCats;
    Categories = Cats;
# ---------- end getparaminfo ----------
getcomponentinfo = CSharpScript(x=get_all_loaded_libraries.A)  # -> out, flatten(Types), flatten(Categories), flatten(SubCategories), flatten(Names), flatten(Descs)
# ---------- getcomponentinfo: C# ----------
    GH_AssemblyInfo gai = x as GH_AssemblyInfo;
    if(gai == null) return;
    Assembly assm = null;
    List<GH_Component> types = new List<GH_Component>();
    List<string> typeNames = new List<string>();
    List<string> compNames = new List<string>();
    
    List<string> Cats = new List<string>();
    List<string> subCats = new List<string>();
    List<string> compDescriptions = new List<string>();

    try {
      assm = gai.Assembly;

      if(assm == null) return;

      var componentsInAssembly = assm.GetTypes().Where(t => t.IsSubclassOf(typeof(GH_Component))).OrderBy(t => t.ToString());


      foreach(Type t in componentsInAssembly){
        try {
          GH_Component component = Activator.CreateInstance(t) as GH_Component;
          if(component.Exposure != GH_Exposure.hidden){
            types.Add(component);
            typeNames.Add(t.ToString());
            compNames.Add(component.Name);
            compDescriptions.Add(component.Description);
            subCats.Add(component.SubCategory);
            Cats.Add(component.Category);
          }

        } catch {

        }
      }

    } catch {

    }


    Types = types;
    Names = compNames;
    Descs = compDescriptions;
    Categories = Cats;
    SubCategories = subCats;
# ---------- end getcomponentinfo ----------
pan_3 = Panel("""<{0}>
{1}
</{0}>""")
rmvempty = RmvEmpty(T=join)
format_10 = Format(Format=pan_2, Culture=127, Data0="OutputParam", Data1=rmvempty)
rmvempty_2 = RmvEmpty(T=join_2)
format_11 = Format(Format=pan_3, Culture=127, Data0="InputParam", Data1=rmvempty_2)
pshift = ShiftPaths(Data=format_10, Offset=-1)
pshift_2 = ShiftPaths(Data=format_11, Offset=-1)
user_object = Data(graft(objects_2))
# Component Info
category_2 = Panel(getcomponentinfo.Categories)
# Param Info
category_3 = Panel(getparaminfo.Categories)
data_2 = Data(getparaminfo.Types)
join_3 = TextJoin(Text=pshift_2)
# Param-Only User Objects
param_info_3 = ParamInfo(Param=user_object)  # -> Name, NickName, DataType, Pivot, Bounds, Sources, Recipients, Kind
join_4 = TextJoin(Text=pshift)
replace_13 = Replace(T=category_3)
replace_14 = Replace(T=category_2)
pan_4 = Panel("""<{0}>
{1}
</{0}>""")
rmvempty_3 = RmvEmpty(T=join_3)
# Icons
componenticon_2 = CSharpScript(x=data_2)  # -> out, A; same code as componenticon
pan_5 = Panel("""<{0}>
{1}
</{0}>""")
rmvempty_4 = RmvEmpty(T=join_4)
subcategory_2 = Panel(getcomponentinfo.SubCategories)
subcategory_3 = Panel(getparaminfo.SubCategories)
format_12 = Format(Format=pan_4, Culture=127, Data0="OutputParams", Data1=rmvempty_4)
txt_2 = Text(data_2)
format_13 = Format(Format=pan_5, Culture=127, Data0="InputParams", Data1=rmvempty_3)
merge_3 = Merge(Data1=format_13, Data2=format_12)
param_names = Panel(param_info_3.Name)
replace_15 = Replace(T=subcategory_2)
replace_16 = Replace(T=subcategory_3)
rmvempty_5 = RmvEmpty(T=merge_3)
names = Panel(getcomponentinfo.Names)
names_2 = Panel(getparaminfo.Names)
pan_6 = Panel("""<{0}>
{1}
</{0}>""")
join_5 = TextJoin(Text=rmvempty_5)
param_nicknames = Panel(param_info_3.NickName)
format_14 = Format(Format=pan_6, Culture=127, Data0="UserObjectParams", Data1=join_5)
replace_17 = Replace(T=names)
replace_18 = Replace(T=names_2)
clean_3 = CleanTree(RemoveNulls=True, RemoveInvalid=True, RemoveEmpty=False, Tree=format_14)
descriptions_3 = Panel(getcomponentinfo.Descs)
descriptions_4 = Panel(getparaminfo.Descs)
param_data_types = Panel(param_info_3.DataType)
panel = Panel(clean_3)
paramdesc_3 = CSharpScript(x=user_object)  # -> out, A; same code as paramdesc
param_descriptions = Panel(paramdesc_3.A)
replace_19 = Replace(T=descriptions_4)
# Component Params
replace_20 = Replace(T=descriptions_3)
component_info_2 = ComponentInfo(Component=getcomponentinfo.Types)  # -> Name, NickName, Guid, ComponentGuid, Inputs, Outputs, Pivot, Bounds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
input_params_2 = Data(component_info_2.Inputs)
output_params_2 = Data(component_info_2.Outputs)
format_15 = Format(Format="<{0}>{1}</{0}>", Culture=127, Data0="Icon", Data1=data)  # -> graft(Text)
format_16 = Format(Format="<{0}>{1}</{0}>", Culture=127, Data0="Description", Data1=replace_12)  # -> graft(Text)
format_17 = Format(Format="<{0}>{1}</{0}>", Culture=127, Data0="Name", Data1=replace_7)  # -> graft(Text)
param_info_4 = ParamInfo(Param=input_params_2)  # -> Name, NickName, DataType, Pivot, Bounds, Sources, Recipients, Kind
param_info_5 = ParamInfo(Param=output_params_2)  # -> Name, NickName, DataType, Pivot, Bounds, Sources, Recipients, Kind
merge_4 = Merge(Data1=format_17, Data2=format_15, Data3=format_16, Data4=clean_3)
format_18 = Format(Format="<{0}>{1}</{0}>", Culture=127, Data0="Description", Data1=replace_20)  # -> graft(Text)
format_19 = Format(Format="<{0}>{1}</{0}>", Culture=127, Data0="Name", Data1=replace_17)  # -> graft(Text)
# Inputs
input_param_names_2 = Panel(param_info_4.Name)
# Inputs
output_param_names_2 = Panel(param_info_5.Name)
join_6 = TextJoin(Text=merge_4)
pan_7 = Panel("""<{0}>
{1}
</{0}>""")
replace_21 = Replace(T=input_param_names_2)
rmvempty_6 = RmvEmpty(T=join_6)
merge_5 = Merge(Data1=flatten(replace_13), Data2=flatten(replace_14), Data3=flatten(replace))  # -> flatten(Result)
merge_6 = Merge(Data1=flatten(replace_16), Data2=flatten(replace_15), Data3=flatten(replace_4))  # -> flatten(Result)
replace_22 = Replace(T=output_param_names_2)
format_20 = Format(Format="<{0}>{1}</{0}>", Culture=127, Data0="Description", Data1=replace_19)  # -> graft(Text)
format_21 = Format(Format="<{0}>{1}</{0}>", Culture=127, Data0="Name", Data1=replace_18)  # -> graft(Text)
input_param_nicknames_2 = Panel(param_info_4.NickName)
output_param_nicknames_2 = Panel(param_info_5.NickName)
format_22 = Format(Format=pan_7, Culture=127, Data0="UserObject", Data1=rmvempty_6)
pshift_3 = ShiftPaths(Data=format_22, Offset=-1)
replace_23 = Replace(T=input_param_nicknames_2)
replace_24 = Replace(T=output_param_nicknames_2)
input_param_data_types_2 = Panel(param_info_4.DataType)
output_param_data_types_2 = Panel(param_info_5.DataType)
panel_2 = Panel(merge_5)
pdbydata = PdByData(data=merge_6)  # -> graft(T)
pdbydata_2 = PdByData(data=merge_5)  # -> graft(T)
pan_8 = Panel("""<{0}>
{1}
</{0}>""")
paramdesc_4 = CSharpScript(x=input_params_2)  # -> out, A; same code as paramdesc
paramdesc_5 = CSharpScript(x=output_params_2)  # -> out, A; same code as paramdesc
merge_7 = Merge(Data1=pdbydata_2, Data2=pdbydata)
replace_25 = Replace(T=input_param_data_types_2)
replace_26 = Replace(T=output_param_data_types_2)
clean_4 = CleanTree(RemoveNulls=True, RemoveInvalid=True, RemoveEmpty=False, Tree=paramdesc_5.A)
format_23 = Format(Format="<{0}>{1}</{0}>", Culture=127, Data0="ParamName", Data1=replace_22)  # -> graft(Text)
clean_5 = CleanTree(RemoveNulls=True, RemoveInvalid=True, RemoveEmpty=False, Tree=paramdesc_4.A)
input_param_descriptions_2 = Panel(clean_5)
path = ConstructPath(Indices=merge_7)
output_param_descriptions_2 = Panel(clean_4)
format_24 = Format(Format="<{0}>{1}</{0}>", Culture=127, Data0="ParamName", Data1=replace_21)  # -> graft(Text)
clean_6 = CleanTree(RemoveNulls=True, RemoveInvalid=True, RemoveEmpty=False, Tree=path)
format_25 = Format(Format="<{0}>{1}</{0}>", Culture=127, Data0="ParamNickName", Data1=replace_24)  # -> graft(Text)
format_26 = Format(Format="<{0}>{1}</{0}>", Culture=127, Data0="ParamNickName", Data1=replace_23)  # -> graft(Text)
clean_7 = CleanTree(RemoveNulls=True, RemoveInvalid=True, RemoveEmpty=False, Tree=path)
replace_27 = Replace(T=input_param_descriptions_2)
replace_28 = Replace(T=output_param_descriptions_2)
format_27 = Format(Format="<{0}>{1}</{0}>", Culture=127, Data0="ParamDataType", Data1=replace_26)  # -> graft(Text)
format_28 = Format(Format="<{0}>{1}</{0}>", Culture=127, Data0="ParamDataType", Data1=replace_25)  # -> graft(Text)
panel_4 = Panel(clean_7)
format_29 = Format(Format="<{0}>{1}</{0}>", Culture=127, Data0="ParamDesc", Data1=replace_28)  # -> graft(Text)
merge_8 = Merge(Data1=format_23, Data2=format_25, Data3=format_27, Data4=format_29)
format_30 = Format(Format="<{0}>{1}</{0}>", Culture=127, Data0="ParamDesc", Data1=replace_27)  # -> graft(Text)
merge_9 = Merge(Data1=format_24, Data2=format_26, Data3=format_28, Data4=format_30)
join_7 = TextJoin(Text=merge_8)
pan_9 = Panel("""<{0}>
{1}
</{0}>""")
pshift_4 = ShiftPaths(Data=merge_9, Offset=-1)
join_8 = TextJoin(Text=merge_9)
rmvempty_7 = RmvEmpty(T=join_7)
pan_10 = Panel("""<{0}>
{1}
</{0}>""")
format_31 = Format(Format=pan_9, Culture=127, Data0="OutputParam", Data1=rmvempty_7)
rmvempty_8 = RmvEmpty(T=join_8)
pshift_5 = ShiftPaths(Data=format_31, Offset=-1)
format_32 = Format(Format=pan_10, Culture=127, Data0="InputParam", Data1=rmvempty_8)
pshift_6 = ShiftPaths(Data=format_32, Offset=-1)
join_9 = TextJoin(Text=pshift_6)
join_10 = TextJoin(Text=pshift_5)
pan_11 = Panel("""<{0}>
{1}
</{0}>""")
rmvempty_9 = RmvEmpty(T=join_9)
pan_12 = Panel("""<{0}>
{1}
</{0}>""")
rmvempty_10 = RmvEmpty(T=join_10)
format_33 = Format(Format=pan_11, Culture=127, Data0="OutputParams", Data1=rmvempty_10)
format_34 = Format(Format=pan_12, Culture=127, Data0="InputParams", Data1=rmvempty_9)
merge_10 = Merge(Data1=format_34, Data2=format_33)
pan_13 = Panel("""<{0}>
{1}
</{0}>""")
join_11 = TextJoin(Text=merge_10)
format_35 = Format(Format=pan_13, Culture=127, Data0="ComponentParams", Data1=join_11)
pan_14 = Panel("""<{0}>
{1}
</{0}>""")
assign_paths = AssignPaths(InputData=flatten(merge_6), PathsToAssign=flatten(clean_6))
assign_paths_2 = AssignPaths(InputData=flatten(merge_5), PathsToAssign=flatten(clean_6))
item = ListItem(List=assign_paths_2, Index=0, Wrap=True)
item_2 = ListItem(List=assign_paths, Index=0, Wrap=True)
pshift_7 = ShiftPaths(Data=item, Offset=-1)
item_3 = ListItem(List=pshift_7, Index=0, Wrap=True)
pan_15 = Panel("""<SubCategory Name="{0}">
{1}
</SubCategory>""")
pan_16 = Panel("""<Category Name="{0}">
{1}
</Category>""")
panel_5 = Panel("""<?xml version="1.0" encoding="UTF-8"?>
<GH_Documentation>""")
text_output_save_location = Panel("C:\My Documents\Desktop\GH_Docs.txt")

data_3 = Data(getcomponentinfo.Types)
icon_save_location_2 = Panel("C:\My Documents\Desktop\GH_Icons\{0}.png")
componenticon_3 = CSharpScript(x=data_3)  # -> out, A; same code as componenticon
txt_3 = Text(data_3)
format_36 = Format(Format=icon_save_location_2, Culture=127, Data0=txt_3)
save_all_icons_2 = BooleanToggle(False)

format_37 = Format(Format=icon_save_location_2, Culture=127, Data0=txt_2)

c_script_2 = CSharpScript(run=save_all_icons_2, BMP=[componenticon_3.A, componenticon_2.A], savePath=[format_36, format_37])  # -> out, A; inputs run: Boolean, savePath: String; same code as c_script

icon_saved_filepaths = Panel(format_36)
format_38 = Format(Format="<{0}>{1}</{0}>", Culture=127, Data0="Icon", Data1=format_36)  # -> graft(Text)
format_39 = Format(Format="<{0}>{1}</{0}>", Culture=127, Data0="Icon", Data1=format_37)  # -> graft(Text)
merge_11 = Merge(Data1=format_21, Data2=format_39, Data3=format_20)
join_12 = TextJoin(Text=merge_11)
rmvempty_11 = RmvEmpty(T=join_12)
format_40 = Format(Format=pan_8, Culture=127, Data0="FloatingParam", Data1=rmvempty_11)
pshift_8 = ShiftPaths(Data=format_40, Offset=-1)
merge_12 = Merge(Data1=format_19, Data2=format_38, Data3=format_18)
merge_13 = Merge(Data1=merge_12, Data2=format_35)
join_13 = TextJoin(Text=merge_13)
format_41 = Format(Format=pan_14, Culture=127, Data0="Component", Data1=join_13)
pshift_9 = ShiftPaths(Data=format_41, Offset=-1)
merge_14 = Merge(Data1=flatten(pshift_8), Data2=flatten(pshift_9), Data3=flatten(pshift_3))
assign_paths_3 = AssignPaths(InputData=flatten(merge_14), PathsToAssign=flatten(path))
join_14 = TextJoin(Text=assign_paths_3)
format_42 = Format(Format=pan_15, Culture=127, Data0=item_2, Data1=join_14)
join_15 = TextJoin(Text=format_42)
pshift_10 = ShiftPaths(Data=join_15, Offset=-1)
join_16 = TextJoin(Text=pshift_10)
format_43 = Format(Format=pan_16, Culture=127, Data0=item_3, Data1=join_16)
merge_15 = Merge(Data1=panel_5, Data2=flatten(format_43), Data3=flatten("</GH_Documentation>"))
writetofile = CSharpScript(run=Toggle(False), txt=flatten(merge_15), file=text_output_save_location)  # -> out, A; inputs run: Boolean, txt: list of String, file: String
# ---------- writetofile: C# ----------
    if(run) File.WriteAllLines(file, txt);
# ---------- end writetofile ----------

# ==== cluster RmvEmpty
T = ClusterInput()
trim = TextTrim(Text=T, Start=True, End=True)
len = TextLength(Text=trim)
dispatch = Dispatch(List=trim, DispatchPattern=len)  # -> ListA, ListB
A = ClusterOutput(dispatch.ListA)

# ==== cluster PdByData
data = ClusterInput()
data_2 = Data(data)
cset = CreateSet(List=flatten(data_2))  # -> Set, Map
unflatten = UnflattenTree(Tree=cset.Map, Guide=data_2)
T = ClusterOutput(unflatten)

# ==== cluster Replace
T = ClusterInput()
rep = ReplaceText(Text=T, Find="<", Replace="&lt;", RecursiveReplace=False)
rep_2 = ReplaceText(Text=rep, Find=">", Replace="&gt;", RecursiveReplace=False)
rep_3 = ReplaceText(Text=rep_2, Find="&", Replace="&amp;", RecursiveReplace=False)
rep_4 = ReplaceText(Text=rep_3, Find="'", Replace="&apos;", RecursiveReplace=False)
rep_5 = ReplaceText(Text=rep_4, Find="\"", Replace="&quot;", RecursiveReplace=False)
R = ClusterOutput(rep_5)
